# Grasshopper definition WoodColumnCrossSection.gh (Grasshopper 0.9.76)

number_slider = Slider(3000, range=0..10000)
crv = Curve(<curve referenced from the Rhino model>)
panel = Panel("af")

# ---- group: Support conditions column
list = ValueList({"Simply supported both ends": 1, "Fixed one end": 2, "One end fixed and one end simply supported": 0.699, "Both ends fixed": 1/2}, selected="Fixed one end")

# ----
len = Length(Curve=crv)

# ---- group: Strength class wood
strength_class_for_wood = ValueList({"C30": 30, "C24": 24, "C18": 18, "C14": 14, "GL32": 32, "Gl28": 28, "GL24": 24}, selected="C14")

# ----
# "Calculation of minimum required moment of inertia for columns"
# 
# "29-09-2017"
# 
# Created by Mikkel Dohm Andersen
load_in_n = Slider(1000, range=0..1000)
multiplication = Multiplication(A=list, B=number_slider)
cluster = Cluster_2()

# ---- group: Calculation af moment of inertia needed
expression = Expression(Ncr=load_in_n, E=strength_class_for_wood, ls=multiplication, Expression="(ls^2*Ncr)/(Pi^2*E)")

# ----
cluster_2 = Cluster(
    critical_load=load_in_n,
    e_modulus=strength_class_for_wood,
    support_conditions=list,
    line_describing_the_end_points_of_column=number_slider)
panel_2 = Panel(cluster_2)
panel_3 = Panel(expression)

# ==== cluster Cluster
critical_load = ClusterInput()  # Critical vertial load for the column
support_conditions = ClusterInput()  # input support conditions for coulmn
line_describing_the_end_points_of_column = ClusterInput()
e_modulus = ClusterInput()  # Quality of wood
multiplication = Multiplication(A=support_conditions, B=line_describing_the_end_points_of_column)
expression = Expression(Ncr=critical_load, E=e_modulus, ls=multiplication, Expression="(ls^2*Ncr)/(Pi^2*E)")
moment_of_inertia = ClusterOutput(expression)  # Moment of inertia needed to take the load

# ==== cluster Cluster_2
support_condition = ClusterInput()  # Input support condition
centerline_of_column = ClusterInput()  # Input centerline of column
strength_class_of_wood = ClusterInput()  # Strngth class of wood for column
load = ClusterInput()  # Critical vertical load for the column
multiplication = Multiplication(A=support_condition, B=centerline_of_column)
expression = Expression(Ncr=load, E=strength_class_of_wood, ls=multiplication, Expression="(ls^2*Ncr)/(Pi^2*E)")
moment_of_inertia = ClusterOutput(expression)  # Moment of inertia needed to carry the load
